# Grasshopper definition AUTONAV2016-AUTOMOTION2.gh (Grasshopper 1.0.7)
# plug-ins: Link

hulldata = Data([30, 6.716176987, 4.18874979, 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, null, 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, 5.569043312])

# ----
# This Solution is linked to another (AUTONAV2016-AUTOHULL.gh)
# All the data of AUTONAV2016-AUTOHULL is internalized  in HULLDATA
panel = Panel("AUTONAV2016-AUTOHULL.gh")
link = DataLink(DocumentName=panel, ComponentGUID="e26fcaeb-1d1b-48ee-b62e-0e734a43e522")  # disabled
panel_2 = Panel(hulldata)

# ----
# keep Y coordinate fixed
# keep X coordinate fixed
# keep Z coordinate fixed
ecart = Slider(1, range=0..20)
basic_hydro = VBScript(DATA=hulldata, Ntrvrs=ecart, DRAFT=Slider(2.579, range=0.5..5))  # -> out, HULL, A, TRANSVERSE, F, PLAN, TXT, SIZE; inputs DATA: list
# ---------- basic_hydro: VB ----------
    Dim arra As New list(Of Object)

    Dim TxtList0 As New list(Of String)
    Dim PlnList  As New list(Of Plane)
    Dim HtList   As New list(Of Double)

    Dim DimPnt1,DimPnt2,DimCtr,DimPnt12,DimPnt22 As New Point3dList
    Dim DIMTITLE,DIMTITLE2 As New list(Of String)
    Dim DIMPlane1,DIMPlane2  As New list(Of plane)
    Dim DIMOffst  As New list(Of Single)
    Dim ht = 0.15

    Dim HULL = DATA(9)
    _HULL = HULL

    Dim bbox = HULL.GetBoundingBox(False):
    Dim L = bbox.GetCorners(1)(0) - bbox.GetCorners(0)(0) ' :Dim Cre = bbox.GetCorners(4)(2)
    Dim B = bbox.GetCorners(2)(1) - bbox.GetCorners(0)(1) ' :Dim Cre = bbox.GetCorners(4)(2)
    Dim D = bbox.GetCorners(4)(2) '- bbox.GetCorners(0)(0)
    Dim ETABL = 0.1 * L
    '[0]Min.X,Min.Y,Min.Z [1]Max.X,Min.Y,Min.Z [2]Max.X,Max.Y,Min.Z [3]Min.X,Max.Y,Min.Z
    '[4]Min.X,Min.Y,Max.Z [5]Max.X,Min.Y,Max.Z [6]Max.X,Max.Y,Max.Z [7]Min.X,Max.Y,Max.Z

    ' PlnList.add(New Plane(New Point3d(L / 2 - ETABL, -0.5 * B - 1.8, D + 1.5), New Vector3d(1, 0, 0)))

    HtList.add(ht)
    TxtList0.add("L " + CStr(Format(L, "0.00"))):
    PlnList.add(New Plane(New Point3d(L / 2 - ETABL, -0.5 * B - 1.8, D + 2.4), New Vector3d(1, 0, 0)))
    HtList.add(ht)
    TxtList0.add("B " + CStr(Format(B, "0.00"))):
    PlnList.add(New Plane(New Point3d(L / 2 - ETABL, -0.5 * B - 1.8, D + 2.1), New Vector3d(1, 0, 0)))
    HtList.add(ht)
    TxtList0.add("D " + CStr(Format(D, "0.00"))):
    PlnList.add(New Plane(New Point3d(L / 2 - ETABL, -0.5 * B - 1.8, D + 1.8), New Vector3d(1, 0, 0)))


    'BUOYANCY At 0.85D_____________________________________________________________________________________________
    'Dim rect1 = New rectangle3d(New Plane(New Point3d(0, 0, 0.85 * D), New Vector3d(0, 0, 1)), _
    Dim rect1 = New rectangle3d(New Plane(New Point3d(0, 0, DRAFT), New Vector3d(0, 0, 1)), _
      New Point3d(-0.2 * L, -B, 0), New Point3d(1.1 * L, B, 0)):            'Arra.add(rect1)
    Dim Cutr = brep.CreatePlanarBreps(rect1.tonurbsCurve):                  'arra.add(Cutr(0))


    Dim Brps = HULL.split(Cutr(0), 0.001):                                   'arra.add(Brps(0))
    Dim BuoyArea = Brps(0).Getarea
    arra.add(Cutr(0))
    arra.add(Brps(0))

    A = arra
    'Exit Sub

    'WaterPlane/before CapPlanarHoles-----------------------------------------------------------------------------------
    'Get Hull naked Edges
    Dim Edgs = Brps(0).DuplicateEdgeCurves(True):'A = Edgs(4)  'Duplicate only naked Edges
    Dim Wplane = brep.CreatePlanarBreps(Edgs)
    bbox = Wplane(0).GetBoundingBox(True):                                   'arra.add(bbox)
    Dim lwl = bbox.GetCorners(1)(0) - bbox.GetCorners(0)(0):                 'Pt1 = bbox.GetCorners(0)(0)
    Dim Lar = bbox.GetCorners(2)(1) - bbox.GetCorners(0)(1):
    Dim _NPL = lwl
    Dim Cwl = Wplane(0).getarea / (lwl * lar)

    HtList.add(ht)
    TxtList0.add("Cwl " + CStr(Format(Cwl, "0.00"))):
    PlnList.add(New Plane(New Point3d(L / 2 - ETABL, -0.5 * B - 1.8, D + .3), New Vector3d(1, 0, 0)))

    Dim Ap As AreaMassProperties = AreaMassProperties.Compute(Wplane(0)) '.Volume
    Dim Lcf = Ap.Centroid(0)

    HtList.add(ht)
    TxtList0.add("Lcf " + CStr(Format(Lcf, "0.00"))):
    PlnList.add(New Plane(New Point3d(L / 2 - ETABL, -0.5 * B - 1.8, D - .3), New Vector3d(1, 0, 0)))

    'Inertia -------------------------------------------------
    Dim WplaneInertie = Ap.CentroidCoordinatesMomentsOfInertia:
    dim It0 = WplaneInertie(0):
    Dim Il0 = WplaneInertie(1)


    'CapPlanarHoles-------------------------------------------------------------------------------------------------------
    Dim CbHull = Brps(0).CapPlanarHoles(0.001):                             'arra.add(Cbhull)

    bbox = Brps(0).GetBoundingBox(True):                                    'arra.add(bbox)
    Dim Tirant = bbox.GetCorners(4)(2) '- bbox.GetCorners(0)(2)
    '[0]Min.X,Min.Y,Min.Z [1]Max.X,Min.Y,Min.Z [2]Max.X,Max.Y,Min.Z [3]Min.X,Max.Y,Min.Z
    '[4]Min.X,Min.Y,Max.Z [5]Max.X,Min.Y,Max.Z [6]Max.X,Max.Y,Max.Z [7]Min.X,Max.Y,Max.Z


    'LCB/KB_____________________________________________________________________________________________
    Dim Vp As VolumeMassProperties = VolumeMassProperties.Compute(Brps(0)) '.Volume
    'vhull = Math.abs(Vp.Volume):   Lcbhull = Vp.Centroid(0):  Kbhull = Vp.Centroid(2) '//////////////////////

    Dim SPHR As New Sphere(Vp.Centroid, 0.1)
    F = SPHR

    '1/Display
    Dim LCB = Vp.Centroid(0)

    HtList.add(ht)
    TxtList0.add("LCB " + CStr(Format(LCB, "0.00"))):
    PlnList.add(New Plane(New Point3d(L / 2 - ETABL, -0.5 * B - 1.8, D), New Vector3d(1, 0, 0)))

    '2/Display in Front View with %
    LCB = (L / 2 - ETABL - LCB) / L: 'LCB = (L / 2 - ETABL - Vp.Centroid(0)) / L
    DimPnt1.add(New Point3d(L / 2 - ETABL, 0, Vp.Centroid(2))):       DimPnt2.add(New Point3d(Vp.Centroid(0), 0, Vp.Centroid(2)))
    DIMTITLE.add("LCB% " + CStr(Format(100 * LCB, "0.00"))):          DIMPlane1.add(plane.WorldZX):  DIMOffst.add(-Vp.Centroid(2) - 1)

    Dim KB = Vp.Centroid(2)

    HtList.add(ht)
    TxtList0.add("KB " + CStr(Format(KB, "0.00"))):
    PlnList.add(New Plane(New Point3d(L / 2 - ETABL, -0.5 * B - 1.8, D - 0.6), New Vector3d(1, 0, 0)))


    'CB_____________________________________________________________________________________________
    'Vp As VolumeMassProperties = VolumeMassProperties.Compute(Brps(0)) '.Volume
    Dim vol = math.Abs(Cbhull.GetVolume)
    Dim Cb = vol / (lwl * lar * Tirant)

    HtList.add(ht)
    TxtList0.add("Dpl " + CStr(Format(vol * 1.025, "0.00"))):
    PlnList.add(New Plane(New Point3d(L / 2 - ETABL, -0.5 * B - 1.8, D + 1.5), New Vector3d(1, 0, 0)))

    HtList.add(ht)
    TxtList0.add("Cb " + CStr(Format(Cb, "0.00"))):
    PlnList.add(New Plane(New Point3d(L / 2 - ETABL, -0.5 * B - 1.8, D + 1.2), New Vector3d(1, 0, 0)))

    'CP_____________________________________________________________________________________________
    Dim SectCrv = Brep.CreateContourCurves(CbHull, (New Plane(New Point3d(L / 2, 0, 0), New Vector3d(1, 0, 0))))
    SectCrv(0).Translate(bbox.GetCorners(0)(0) - L / 2, 0, 0):                'arra.add(SectCrv(0)):
    ' arra.add(WLCntrCrv(0)):
    Dim Brp = extrusion.CreateExtrusion(SectCrv(0), New vector3d(lwl, 0, 0)):   'arra.add(Brp)
    Dim Cphull = Brp.ToBrep.CapPlanarHoles(0.01):                               'arra.add(Cphull)

    Dim CP = vol / (Cphull.GetVolume)

    HtList.add(ht)
    TxtList0.add("Cp " + CStr(Format(Cp, "0.000"))):
    PlnList.add(New Plane(New Point3d(L / 2 - ETABL, -0.5 * B - 1.8, D + 0.9), New Vector3d(1, 0, 0)))

    'CM_____________________________________________________________________________________________
    'If UBound(WLCntrCrv) = 0 Then
    Ap = AreaMassProperties.Compute(SectCrv(0)): Dim am = Ap.Area

    Dim CM = am / (lar * Tirant)
    'or cp=cb/cm   cm=cb/cp
    HtList.add(ht)
    TxtList0.add("Cm " + CStr(Format(CM, "0.000"))):
    PlnList.add(New Plane(New Point3d(L / 2 - ETABL, -0.5 * B - 1.8, D + .6), New Vector3d(1, 0, 0)))


    'Metacentric Radius_____________________________________________________________________________________________
    Dim rt = It0 / vol:   Dim KMT0 = KB + rt
    Dim rl = Il0 / vol:   Dim KML0 = KB + rl
    'mct(i,j)= v(i,j)*1.025*rl(i,j)/(100*lwl(i,j))     :'Mct=ro.I/100.L with I=Rl.V
    Dim Mct = 1.025 * Il0 / (100 * lwl ):'Mct=ro.I/100.L with I=Rl.V
    Dim Tpc = 1.025 * Wplane(0).getarea / 100

    HtList.add(ht)
    TxtList0.add("rt " + CStr(Format(rt, "0.00"))):
    PlnList.add(New Plane(New Point3d(L / 2 - ETABL, -0.5 * B - 1.8, D - .9), New Vector3d(1, 0, 0)))

    HtList.add(ht)
    TxtList0.add("Rl " + CStr(Format(rl, "0.00"))):
    PlnList.add(New Plane(New Point3d(L / 2 - ETABL, -0.5 * B - 1.8, D - 1.2), New Vector3d(1, 0, 0)))

    HtList.add(ht)
    TxtList0.add("Mct " + CStr(Format(Mct, "0.00"))):
    PlnList.add(New Plane(New Point3d(L / 2 - ETABL, -0.5 * B - 1.8, D - 1.5), New Vector3d(1, 0, 0)))

    HtList.add(ht)
    TxtList0.add("Tpc " + CStr(Format(Tpc, "0.00"))):
    PlnList.add(New Plane(New Point3d(L / 2 - ETABL, -0.5 * B - 1.8, D - 1.8), New Vector3d(1, 0, 0)))


    'Display______
    TxT = TxtList0
    SIZE = HtList
    PLAN = PlnList

    Djmp5:


    'exit sub


    Dim Transverses As Curve() = Nothing

    'Dim arra As New  list(Of Object)
    bbox = HULL.GetBoundingBox(True)
    Dim Bcorners = bbox.GetCorners

 
    'Extract Transverses
    If Ntrvrs <> 0 Then  Transverses = Brep.CreateContourCurves(HULL, _
        New Point3d(Bcorners(0)(0), 0, 0), New Point3d(Bcorners(1)(0), 0, 0), Ntrvrs)

    'Dim Transverses2 =
    Dim i As int32 = 0
    Dim Transverses2(Ntrvrs+1) As Polyline
    'For Each crv As curve In Transverses
    For i = 0 To  Ntrvrs - 1
      'Transverses2(i) = crv.ToPolyline(0, 0, 0.0, 0.0, 0.0, var, 0.0, 0.0, True)
      'Transverses2(i).TryGetPolyline(Transverses(i))
      ' i = i + 1
    Next
    TRANSVERSE = Transverses '2 'List1'Transverses
# ---------- end basic_hydro ----------
geo = Geometry(basic_hydro.TRANSVERSE)  # disabled
hyd_prop = TextTag3D(Location=basic_hydro.PLAN, Text=basic_hydro.TXT, Size=basic_hydro.SIZE, Justification=7)
geo_2 = Geometry(basic_hydro.HULL)  # disabled
panel_3 = Panel(basic_hydro.TXT)

max_roll_periode_a749_18 = VBScript(DIMENSIONS=basic_hydro.TXT, Ls="0", AMPLITUDE="0.35")  # -> out, PERIODE, Ampl_reg, A; inputs DIMENSIONS: list
# ---------- max_roll_periode_a749_18: VB ----------
    Dim GMreg,C,Tperiode,PHI,Fb,Tirant As Single
    Dim hi(6), pi(6), bsdi(11), cbi(6) As Single

    Dim i As int32
    Dim aki(8), pri(8), x1i(11), x2i(6), ki(8), si(8) As Single
    Dim lpp,lar,cre,bsd,cbc,X1,X2,k,s,r,OG_sD  As Single
    Dim TxtList0 As New list(Of String)

    Dim L = CSng(Mid(DIMENSIONS(0),2))
    Dim B = CSng(Mid(DIMENSIONS(1),2))
    Dim D = CSng(Mid(DIMENSIONS(2),2))

    '--------------------------------------------------------------------------------------------------------
    'PHI = AMPLITUDE
    Fb = 0.15 * D
    Tirant = 0.85 * D
    GMreg = 0.53 + 2 * B * (0.075 - 0.37 * (Fb / B) + 0.82 * (Fb / B) - 0.014 * (B / D) - 0.032 * (Ls / L))
    C = 0.746 + 0.046 * (B / Tirant) - 0.086 * (L / 100)

    Tperiode = C * B / (math.Sqrt(GMreg))
    PERIODE = Tperiode
    '--------------------------------------------------------------------------------------------------------

    'cbc = CSng(Mid(Cb(5),3)) 'Pick Cb
    cbc = CSng(Mid(DIMENSIONS(8),3)) 'Pick Cb
    TxtList0.add("Cb=" & cbc)


    'A749 (18)_______________________________________________________________________________________________________
    'Tableau  Pression
    hi(1) = 1: hi(2) = 2: hi(3) = 3: hi(4) = 4: hi(5) = 5: hi(6) = 6
    pi(1) = 316: pi(2) = 386: pi(3) = 429: pi(4) = 460: pi(5) = 485: pi(6) = 504
    'Tableau  X1
    bsdi(1) = 2.4: bsdi(2) = 2.5: bsdi(3) = 2.6: bsdi(4) = 2.7: bsdi(5) = 2.8
    bsdi(6) = 2.9: bsdi(7) = 3:   bsdi(8) = 3.1: bsdi(9) = 3.2: bsdi(10) = 3.4: bsdi(11) = 3.5
    x1i(1) = 1:    x1i(2) = 0.98: x1i(3) = 0.96: x1i(4) = 0.95: x1i(5) = 0.93
    x1i(6) = 0.91: x1i(7) = 0.9:  x1i(8) = 0.88: x1i(9) = 0.86: x1i(10) = 0.82: x1i(11) = 0.8
    'Tableau  X2
    cbi(1) = 0.45: cbi(2) = 0.5:  cbi(3) = 0.55: cbi(4) = 0.6:  cbi(5) = 0.65: cbi(6) = 0.7
    x2i(1) = 0.75: x2i(2) = 0.82: x2i(3) = 0.89: x2i(4) = 0.95: x2i(5) = 0.97: x2i(6) = 1
    'Tableau  K
    aki(1) = 0: aki(2) = 1:   aki(3) = 1.5: aki(4) = 2:   aki(5) = 2.5: aki(6) = 3:  aki(7) = 3.5:   aki(8) = 4
    ki(1) = 1:  ki(2) = 0.98: ki(3) = 0.95: ki(4) = 0.88: ki(5) = 0.79: ki(6) = 0.74: ki(7) = 0.72:  ki(8) = 0.70
    'Tableau  S
    pri(1) = 6:  pri(2) = 7:    pri(3) = 8:    pri(4) = 12:   pri(5) = 14:   pri(6) = 16:   pri(7) = 18:   pri(8) = 20
    si(1) = 0.1: si(2) = 0.098: si(3) = 0.093: si(4) = 0.065: si(5) = 0.053: si(6) = 0.044: si(7) = 0.038: si(8) = 0.035

    'Basic Data----------------------------------------------------------------------------
    lar = B:   cre = D:  lpp = L
    bsd = lar / cre

    'lininterpol   x1--------------------
    For i = 1 To 11
      If bsdi(i) > bsd Then x1 = INTERPOL(i, bsdi, x1i, bsd): Exit For
    Next i
    If i >= 11 Then x1 = x1i(11)
    TxtList0.add("X1=" & x1)

    'lininterpol   x2--------------------
    'For i = 3 To nleH   'interpol cb
    '  If DepH(Itrim, i) > displ Then cbc = INTERPOL22T(i, DepH, cb, displ): Exit For
    'Next i

    For i = 1 To 6   'cbloc already interpolated in wtcas (PROCESS_CA1)
      If cbi(i) > cbc Then x2 = INTERPOL(i, cbi, x2i, cbc): Exit For
    Next i
    If i >= 6 Then x2 = x2i(6)
    TxtList0.add("X2=" & x2)

    'lininterpol   k--------------------
    For i = 1 To 8
      If aki(i) > bsd Then k = INTERPOL(i, aki, ki, bsd): Exit For
    Next i
    If i >= 7 Then k = ki(8)
    'Coefk = k
    TxtList0.add("k=" & x2)

    'lininterpol   s--------------------
    For i = 1 To 8
      If pri(i) > Tperiode Then s = INTERPOL(i, pri, si, Tperiode): Exit For
    Next i
    If i >= 8 Then s = si(7)
    TxtList0.add("s=" & x2)

    'r             ---------------------------------------------------------
    'Approximation of Og/d    Og = ( 0.85 * D + 0.075 * D) / 0.85 * D
    OG_sD = 0.08
    r = 0.73 + +0.6 * OG_sD

    'Roll Amplitude --------------------
    PHI = 109 * k * X1 * X2 * math.Sqrt(r * s)
    Ampl_reg = PHI * 3.14 / 180

    TxtList0.add("PHI=" & PHI)

    A = TxtList0 'cbc 'Cb(5)
  End Sub

  Function INTERPOL(ByVal j As Integer, ByRef xi() As Single, ByRef yi() As Single, ByVal x0 As Single)
    Dim Dlta , y As Single

    Dlta = (yi(j) - yi(j - 1)) / (xi(j) - xi(j - 1)): y = yi(j - 1) + (x0 - xi(j - 1)) * Dlta

    INTERPOL = y

  End Function


  Sub NothingToDo()
# ---------- end max_roll_periode_a749_18 ----------
panel_4 = Panel(max_roll_periode_a749_18.Ampl_reg)

excel_enable_run = BooleanToggle(False)
panel_5 = Panel(max_roll_periode_a749_18.A)
roll_test_rz = Button()
run100 = BooleanToggle(False)
timer = Timer(TimerInterval=1, Target=stoprolltest)
waveoption = ValueList({"Wave 0": 0, "Wave 1": 1, "Wave 2": 2, "Wave 3": 3, "Wave 4": 4, "Wave 5": 5, "Wave 6": 6, "Wave 7": 7}, selected="Wave 2")
amplitude = Slider(0.7, range=0..5)
length_λ_m = Slider(50, range=10..200)
periode_t_s = Slider(15, range=1..100)
phase_ɛ = Slider(90, range=0..180)
heading = Slider(90, range=0..180)
pitch = Slider(1.2, range=1..10)
roll = Slider(0.1, range=0..10)
heave = Slider(1, range=0..10)
wind = Slider(0, range=-60..60)
rolldamping = Slider(0.01, range=0.005..1)

remote = Button()
_⓿ = VBScript(RZ=remote)  # -> A; disabled
# ---------- _⓿: VB ----------
    Dim ghObjects = owner.OnPingDocument().Objects

    If Not rz Then Return

    For Each obj As Object In ghObjects
      If  obj.NickName = "RUN100"   Then
        If oldVal = 1 Then
          obj.value = 0: oldVal = 0
        Else If oldVal = 0 Then
          obj.value = 1: oldVal = 1
        End If
        obj.ExpireSolution(True)
      End If
    Next


    A = oldVal

    '
# ---------- _⓿: VB additional code ----------
  Dim oldVal As int32
# ---------- end _⓿ ----------

stoprolltest = VBScript(EXCELIN=excel_enable_run, RUN=run100, RZ=roll_test_rz)  # -> DATATEXT, DATAOUT, RZout, CLOCK
# ---------- stoprolltest: VB ----------
    Dim xlApp,SHEETSPECIF As Object
    Dim arrData,arrData2 As New list(Of Object)
    Dim DYNRUN,DYNROLL As Boolean

    'arrData.add(DATA)
    xlApp = System.Runtime.InteropServices.Marshal.GetActiveObject("Excel.Application")
    SHEETSPECIF = xlApp.Worksheets("SPECIFICATIONS")

    'Dim STOPROLLTEST = SHEETSPECIF.Range("DYNSTOPROLLTEST").Value
    'If STOPROLLTEST = 1 Then Run = True


    Try
      'DYNRUN = SHEETSPECIF.Range("DYNRUN").Value

      ' If SHEETSPECIF.Range("DYNRZ").Value = 1 Then  count = 0

      'Working DATA
      arrData.add(SHEETSPECIF.Range("DynRollAmp").Value)
      arrData.add(SHEETSPECIF.Range("DynRollPhas").Value)
      arrData.add(SHEETSPECIF.Range("DynPitchAmp").Value)
      arrData.add(SHEETSPECIF.Range("DynPitchPhas").Value)
      arrData.add(SHEETSPECIF.Range("DynHeaveAmp").Value)
      arrData.add(SHEETSPECIF.Range("DynHeavePhas").Value)

      arrData.add(SHEETSPECIF.Range("DynAmplitude").Value)
      arrData.add(SHEETSPECIF.Range("DynWaveLenght").Value)
      arrData.add(SHEETSPECIF.Range("DynWavePeriode").Value)
      arrData.add(SHEETSPECIF.Range("DynWavePhase").Value)
      arrData.add(SHEETSPECIF.Range("DynWaveHarmonic").Value)

      arrData.add(SHEETSPECIF.Range("DynRollPlus").Value)
      arrData.add(SHEETSPECIF.Range("DynPitchPlus").Value)
      arrData.add(SHEETSPECIF.Range("DynHeavePlus").Value)

      arrData.add(SHEETSPECIF.Range("DynLIST").Value)

      'Display Working DATA
      arrData2.add("Roll Amplitude = " & SHEETSPECIF.Range("DynRollAmp").Value)
      arrData2.add("Roll Phase = " & SHEETSPECIF.Range("DynRollPhas").Value)
      arrData2.add("Pitch Amplitude = " & SHEETSPECIF.Range("DynPitchAmp").Value)
      arrData2.add("Pitch Phase = " & SHEETSPECIF.Range("DynPitchPhas").Value)
      arrData2.add("Heave Amplitude = " & SHEETSPECIF.Range("DynHeaveAmp").Value)
      arrData2.add("Heave Phase = " & SHEETSPECIF.Range("DynHeavePhas").Value)

      arrData2.add("Wave Amplitude = " & SHEETSPECIF.Range("DynAmplitude").Value)
      arrData2.add("Wave Lenght = " & SHEETSPECIF.Range("DynWaveLenght").Value)
      arrData2.add("Wave Periode = " & SHEETSPECIF.Range("DynWavePeriode").Value)
      arrData2.add("Wave Phase = " & SHEETSPECIF.Range("DynWavePhase").Value)
      arrData2.add("Wave Harmonic = " & SHEETSPECIF.Range("DynWaveHarmonic").Value)

      arrData2.add("Roll + = " & SHEETSPECIF.Range("DynRollPlus").Value)
      arrData2.add("Pitch + = " & SHEETSPECIF.Range("DynPitchPlus").Value)
      arrData2.add("Heave + = " & SHEETSPECIF.Range("DynHeavePlus").Value)

      arrData2.add("Initial List = " & SHEETSPECIF.Range("DynLIST").Value)

      DATAOUT = arrData
      DATATEXT = arrData2

    Catch
      MsgBox("OPEN EXCEL SPECIFICATIONS")
    End Try

    If EXCELIN Then
      DYNRUN = SHEETSPECIF.Range("DYNRUN").Value
      DYNROLL = SHEETSPECIF.Range("DYNRZ").Value
      'OUTOUF = SHEETSPECIF.Range("DYNOUTOUF").Value

      RZ = DYNROLL:
      RUN = DYNRUN
    End If
    'TIMER _____________________________________________________________________________________

    ' If  DYNRZ Then  Run = DYNRZ 'condition to run or Stop Counter from Excel with regard to line 182

    'PRIORITY of DYNRUN or RZ
    ' If RZ = 1 Then DYNRUN = 1
    ' If DYNRUN = 0 Then Run = 0

    If RUN  Then

      Try
        'OUTOUF = SHEETSPECIF.Range("DYNOUTOUF").Value

        'If DYNRUN Or RUN Then
        If  RZ Then RZout = True  Else  RZout = False
        'End If

      Catch
      End Try


      count += 1
      CLOCK = count


      Dim ghdoc As GH_Document = owner.OnPingDocument()
      If (ghdoc Is Nothing) Then Return
      'Then, iterate over all objects in the document to find all timers.
      For Each docobj As IGH_DocumentObject In ghdoc.Objects
        'Try to cast the object to a GH_Timer
        Dim timer As Special.GH_Timer = TryCast(docobj, Special.GH_Timer)
        If (timer Is Nothing) Then Continue For
        'If the cast was successful, then see if this component is part of the timer target list.
        If (timer.Targets.Contains(owner.InstanceGuid)) Then
          'If it is, lock the timer.
          timer.Locked = Not Run
        End If
      Next


    End If
    ' If RZ Then RZout = 1  Else RZout = 0
# ---------- stoprolltest: VB additional code ----------
  Dim  count As int32
# ---------- end stoprolltest ----------
# SHIP DYNAMICS
panel_6 = Panel(stoprolltest.DATATEXT)
panel_7 = Panel(stoprolltest.DATAOUT)
panel_8 = Panel(stoprolltest.CLOCK)
motion_solver = VBScript(
    EXCELIN=excel_enable_run,
    WaveOption=waveoption,
    Geo=basic_hydro.HULL,
    BPLAN=basic_hydro.TRANSVERSE,
    CLOCK=stoprolltest.CLOCK,
    Amplitude=amplitude,
    LENGTH=length_λ_m,
    PERIODE=periode_t_s,
    PHASE=phase_ɛ,
    HEADING=heading,
    HARMONIQUE=1,
    SHIPMOTIONS=stoprolltest.DATAOUT,
    PlusPitch=pitch,
    PlusRoll=roll,
    PlusHeave=heave,
    InitiaList0=wind,
    RZ=stoprolltest.RZout,
    PHI=panel_4,
    T_Roll=max_roll_periode_a749_18.PERIODE,
    ROLLDAMPER=rolldamping)  # -> out, SEAPLAN, SEACURVE, KELVIN, SEADEPTH, BALL, Geomat, BPlanmat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; inputs Geo: list of GeometryBase, BPLAN: list of Curve, SHIPMOTIONS: list
# ---------- motion_solver: VB ----------
    Dim i,j,ii,jj,step0      As int32
    Dim Fx                   As Single
    Dim ptarr,ptarr2         As New Point3dList
    'Dim ptarr2d() As Point2d
    Dim Arra,Arrb,Arrc,Arrd  As New list(Of Object)
    Dim crvarrx              As New CurveList
    Dim Crv = Nothing
    Dim Wave = Nothing
    Dim K(10)                As Single
    Dim InitiaList  As Double


    '  If     (SHIPMOTIONS(0)) = Nothing Then KelvinStep = 0:ReDim  KelvinCrv(0) :     Return
    If SHIPMOTIONS(0) = 0 Then  SHIPMOTIONS(0) = 0.001
    ' If RZ Then InitiaList = -50 Else InitiaList = 0
    ' If RZ Then OUTOUF = -50:ROLLAMP0 = 0.8
    'B = SHIPMOTIONS
    If EXCELIN = True Then
      Amplitude = SHIPMOTIONS(6)
      LENGTH = SHIPMOTIONS(7)
      PERIODE = SHIPMOTIONS(8)
      PHASE = SHIPMOTIONS(9)
      Harmonique = SHIPMOTIONS(10)
      PlusRoll = SHIPMOTIONS(11)
      PlusPitch = SHIPMOTIONS(12)
      PlusHeave = SHIPMOTIONS(13)
      ' InitiaList = SHIPMOTIONS(14):
    Else
      'InitiaList = InitiaList
    End If


    Dim xlApp,SHEETSPECIF As Object
    'Try
    xlApp = System.Runtime.InteropServices.Marshal.GetActiveObject("Excel.Application")
    SHEETSPECIF = xlApp.Worksheets("SPECIFICATIONS")
    'Catch
    'End Try


    Dim Amplitude0,Harmo0,Ka0,Freq0,Phase0   As Single

    Amplitude0 = 1.5:Harmo0 = 1:Ka0 = 0.5:Freq0 = 0.1:Phase0 = 0
    'Time = Time + 1' Timer1.ToString

    Dim Frequency = 6.28 / PERIODE    'Frequency = 0.3
    Dim NUMBER_K = 6.28 / LENGTH      'NUMBER_K = 0.27

    step0 = 10
    Dim n01 = 10'Obj01.Length-1
    Dim m01 = 10'Obj01.Length-1
    m01 = 2 * m01
    Dim opt = 2

    Dim Exlarray(1,10) As Single

    Select Case WaveOption
      Case 0
        Amplitude = 0.5
        For i = n01 To 0 Step-1
          ii = 4 * i - 10
          fx = Amplitude * Math.cos(NUMBER_K * ii + Frequency * CLOCK + PHASE)
          ptarr.Add(ii, -20, fx) 'Wave Curve Points Construction

          ' Exlarray(0, i) = ii:Exlarray(1, i) = fx
        Next
        WAVE = Surface.CreateExtrusion(Curve.CreateControlPointCurve(Ptarr, 3), New Vector3d(0, 40, 0)):    'WAVE = Extrusion.Create(Crv, -20, True):  arra.add(BLKHD0)

        'SHEETSPECIF.range("M201:N211").value = xlApp.WorksheetFunction.Transpose(Exlarray)
        KELVIN = ptarr2

      Case 1
        'n01 = 15
        For i = n01 To 0 Step-1
          ii = 4 * i - 10
          fx = Amplitude * Harmonique * Math.cos(NUMBER_K * ii + Frequency * CLOCK + PHASE)
          ptarr.Add(1 * ii, -20, fx) 'Wave Curve Points Construction

        Next
        'Wave Curve Construction
        'Crv = Curve.CreateControlPointCurve(Ptarr, 7):  'Dim Crv2 = Crv.Duplicate.Translate(0, 20, 0) ' :.Duplicate :Crv2 = Crv2.tra
        'Sea Plane Construction
        WAVE = Surface.CreateExtrusion(Curve.CreateControlPointCurve(Ptarr, 3), New Vector3d(0, 40, 0)):    'WAVE = Extrusion.Create(Crv, -20, True):  arra.add(BLKHD0)

      Case 2
        'n01 = 12
        For i = n01 To 0 Step-1
          ii = 4 * i - 10
          fx = Amplitude * Harmonique * Math.cos(NUMBER_K * ii + Frequency * CLOCK + PHASE)
          fx = fx + Amplitude * Harmonique * Math.cos(NUMBER_K * 0.1 * ii + 0.5 * Frequency * CLOCK + PHASE)
          fx = fx + Amplitude * Harmonique * Math.cos(NUMBER_K * 0.3 * ii + 0.6 * Frequency * CLOCK + PHASE)
          fx = fx + Amplitude * Harmonique * Math.cos(NUMBER_K * 0.7 * ii + 0.7 * Frequency * CLOCK + PHASE)
          fx = fx + Amplitude * Harmonique * Math.cos(NUMBER_K * 0.9 * ii + 0.8 * Frequency * CLOCK + PHASE)
          ptarr.Add(1 * ii, -m01, fx)

        Next
        'Crv = Curve.CreateControlPointCurve(Ptarr, 7):  'Dim Crv2 = Crv.Duplicate.Translate(0, 20, 0) ' :.Duplicate :Crv2 = Crv2.tra
        'WAVE = Surface.CreateExtrusion(Crv, New Vector3d(0, 2 * m01, 0)):    'WAVE = Extrusion.Create(Crv, -20, True):  arra.add(BLKHD0)
        WAVE = Surface.CreateExtrusion(Curve.CreateControlPointCurve(Ptarr, 3), New Vector3d(0, 2 * m01, 0)):    'WAVE = Extrusion.Create(Crv, -20, True):  arra.add(BLKHD0)
      'SEACURVE = Crv

      Case 3
        'K(0) = 1 * NUMBER_K:K(1) = 1.5 * NUMBER_K:K(2) = 2 * NUMBER_K:K(3) = 2.5 * NUMBER_K:K(4) = 3 * NUMBER_K:K(5) = 1 * NUMBER_K
        'K(6) = 1 * NUMBER_K:K(7) = 1 * NUMBER_K:K(8) = 1 * NUMBER_K:K(9) = 1 * NUMBER_K:K(10) = 1 * NUMBER_K

        'n01 = 10
        For i = 0  To n01
          ' ii = 5 * i - n01 * 3 / 2'15
          ii = 4 * i - 10

          For j = 0  To m01
            NUMBER_K = 6.28 / (.5 * (jj + 1) * LENGTH / n01)
            'NUMBER_K = K(j)
            jj = 2 * j - m01
            fx = Amplitude * Math.sin(NUMBER_K * ii * Math.cos(3.14 / 1) + NUMBER_K * jj * Math.sin(3.14 / 1) + Frequency * CLOCK + PHASE)
            'fx = 2 * ((fx + 1) / 2) ^ 2.5
            ptarr.Add(ii, jj, fx)
            ' ptarr2.Add(ii, jj, fx)
          Next
          'Dim Crv2 = Curve.CreateControlPointCurve(Ptarr, 3):  'Dim Crv2 = Crv.Duplicate.Translate(0, 20, 0) ' :.Duplicate :Crv2 = Crv2.tra
          'Arrd.Add(Crv2)
          'SEACURVE = ptarr 'Arrd
          'ptarr2.clear
        Next
        WAVE = NurbsSurface.CreateFromPoints(ptarr, n01 + 1, m01 + 1, 3, 3)

      Case 4
        'n01 = 10
        For i = 0  To n01
          ' ii = 5 * i - n01 * 3 / 2'15
          ii = 4 * i - 10

          For j = 0  To 2 * n01
            jj = 2 * j - 2 * n01
            fx = Amplitude * Math.sin(NUMBER_K * ii * Math.cos(3.14 / 4) + NUMBER_K * jj * Math.sin(3.14 / 4) + Frequency * CLOCK + PHASE)
            'fx = 2 * ((fx + 1) / 2) ^ 2.5
            ptarr.Add(ii, jj, fx)
            'ptarr2.Add(ii, jj, fx)
          Next
          Dim Crv2 = Curve.CreateControlPointCurve(Ptarr, 3):  'Dim Crv2 = Crv.Duplicate.Translate(0, 20, 0) ' :.Duplicate :Crv2 = Crv2.tra
          'Arrd.Add(Crv2)
          'SEACURVE = Arrd
          'ptarr2.clear
        Next
        WAVE = NurbsSurface.CreateFromPoints(ptarr, n01 + 1, 2 * n01 + 1, 3, 3)

      Case 5
        K(0) = 1 * NUMBER_K:K(1) = 1.5 * NUMBER_K:K(2) = 2 * NUMBER_K:K(3) = 2.5 * NUMBER_K:K(4) = 3 * NUMBER_K:K(5) = 4 * NUMBER_K
        K(6) = 3 * NUMBER_K:K(7) = 2.5 * NUMBER_K:K(8) = 2 * NUMBER_K:K(9) = 1.5 * NUMBER_K:K(10) = 1 * NUMBER_K

        For j = 0  To n01
          'NUMBER_K = K(j)  '6.28 / ((ii + 1) * LENGTH / n01)
          'NUMBER_K = 6.28 / ((j + 10) * LENGTH / n01)
          'Ki(0) = 6.28 / ((n01 + 1) * LENGTH / n01
          If j < n01 / 2 Then NUMBER_K = 6.28 / ((j + 10) * LENGTH / n01)
          If j > n01 / 2 Then NUMBER_K = 6.28 / ((j + 1) * LENGTH / n01)

          jj = 2 * j - n01

          For i = 0  To n01
            ii = 5 * i - n01 * 3 / 2'15

            fx = Amplitude * Math.cos(NUMBER_K * ii * Math.cos(3.14 / 1) + NUMBER_K * jj * Math.sin(3.14 / 1) - Frequency * CLOCK + 1 * PHASE)
            ptarr.Add(ii, jj, fx)
            'ptarr2.Add(ii, jj, fx)
          Next
          'Dim Crv4 = Curve.CreateControlPointCurve(Ptarr2, 3):  'Dim Crv2 = Crv.Duplicate.Translate(0, 20, 0) ' :.Duplicate :Crv2 = Crv2.tra
          'Arrd.Add(Crv4)
          'SEACURVE = Arrd
          'ptarr2.clear

        Next
        jmp4:

        ' Dim Crv2 = Curve.CreateControlPointCurve(Ptarr, 7):  'Dim Crv2 = Crv.Duplicate.Translate(0, 20, 0) ' :.Duplicate :Crv2 = Crv2.tra
        WAVE = NurbsSurface.CreateFromPoints(ptarr, n01 + 1, n01 + 1, 3, 3)
      Case 6
        K(0) = 1 * NUMBER_K:K(1) = 1.5 * NUMBER_K:K(2) = 2 * NUMBER_K:K(3) = 2.5 * NUMBER_K:K(4) = 3 * NUMBER_K:K(5) = 1 * NUMBER_K
        K(6) = 1 * NUMBER_K:K(7) = 1 * NUMBER_K:K(8) = 1 * NUMBER_K:K(9) = 1 * NUMBER_K:K(10) = 1 * NUMBER_K
        Dim Frequency1,Frequency2,Frequency3,Frequency4 As Single
        Dim Amplitude1,Amplitude2,Amplitude3,Amplitude4 As Single
        Dim PHASE1,PHASE2,PHASE3,PHASE4 As Single
        Dim Beta1,Beta2,Beta3,Beta4 As Single
        Dim K1,K2,K3,K4 As Single
        Dim g = 9.81

        Frequency1 = 1 * Frequency:   Frequency2 = 1 * Frequency:   Frequency3 = 1 * Frequency:   Frequency4 = 1 * Frequency:
        Amplitude1 = 0.2 * Amplitude:   Amplitude2 = 0.6 * Amplitude:   Amplitude3 = 0.8 * Amplitude:   Amplitude4 = 0.8 * Amplitude:
        PHASE1 = 1 * PHASE:             PHASE2 = 2 * PHASE:             PHASE3 = 5 * PHASE:             PHASE4 = 8 * PHASE:
        ' Beta1 = 0:                      Beta2 = 30:                     Beta3 = 60:                     Beta4 = 90:
        Beta1 = 0 * 3.14 / 180:         Beta2 = 30 * 3.14 / 180:        Beta3 = 60 * 3.14 / 180:        Beta4 = 90 * 3.14 / 180:

        NUMBER_K = 6.28 / ( 1 * LENGTH ):Frequency = 1 * math.Sqrt(NUMBER_K * g) / 6.28:
        ' Frequency = 1000
        K1 = 1 * NUMBER_K:                K2 = 10 * NUMBER_K:             K3 = 15 * NUMBER_K:             K4 = 20 * NUMBER_K:
        ' K1 = Frequency1 ^ 2 / g:        K2 = Frequency2 ^ 2 / g:        K3 = Frequency3 ^ 2 / g:         K4 = Frequency4 ^ 2 / g:
        '  Frequency1 = math.Sqrt(k1 * g) / 6.28:  Frequency2 = math.Sqrt(k2 * g) / 6.28:  Frequency3 = math.Sqrt(k3 * g) / 6.28: Frequency4 = math.Sqrt(k4 * g) / 6.28:

        'n01 = 10
        For i = 0  To n01
          ii = 4 * i - 10

          For j = 0  To m01
            jj = 2 * j - m01
            fx = Amplitude * Math.sin(NUMBER_K * ii * Math.cos(3.14 / 1) + NUMBER_K * jj * Math.sin(3.14 / 1) + Frequency * CLOCK + PHASE)
            NUMBER_K = K1
            fx = fx + Amplitude1 * Math.sin(NUMBER_K * ii * Math.cos(Beta1) + NUMBER_K * jj * Math.sin(Beta1) + Frequency1 * CLOCK + PHASE1)
            NUMBER_K = K2
            fx = fx + Amplitude2 * Math.sin(NUMBER_K * ii * Math.cos(Beta2) + NUMBER_K * jj * Math.sin(Beta2) + Frequency2 * CLOCK + PHASE2)
            NUMBER_K = K3
            fx = fx + Amplitude3 * Math.sin(NUMBER_K * ii * Math.cos(Beta3) + NUMBER_K * jj * Math.sin(Beta3) + Frequency3 * CLOCK + PHASE3)
            NUMBER_K = K4
            fx = fx + Amplitude4 * Math.sin(NUMBER_K * ii * Math.cos(Beta4) + NUMBER_K * jj * Math.sin(Beta4) + Frequency4 * CLOCK + PHASE4)

            ptarr.Add(ii, jj, fx)

          Next
        Next
        WAVE = NurbsSurface.CreateFromPoints(ptarr, n01 + 1, m01 + 1, 3, 3)

      Case 7'SHIP RAO  JENSEN WAVE-------------------------------------------
        Select Case BEAUFORT
          Case 1:Amplitude = 0.1
          Case 2:Amplitude = 0.3
          Case 3:Amplitude = 1
          Case 4:Amplitude = 1.5
          Case 5:Amplitude = 2.5
          Case 6:Amplitude = 4
          Case 7:Amplitude = 5.5
          Case 8:Amplitude = 7.5
        End Select
        'Frequency = 0.2

        'Dim K0,K1,K2,K3,K4 As Single
        'Dim Frequency1,Frequency2,Frequency3,Frequency4 As Single
        'Dim Amplitude1,Amplitude2,Amplitude3,Amplitude4 As Single
        'Dim PHASE1,PHASE2,PHASE3,PHASE4 As Single
        'Dim HEADING0,HEADING1,HEADING2,HEADING3,HEADING4 As Single
        Dim HEADING0  As Single
        Dim g = 9.81

        HEADING0 = HEADING * 3.14 / 180:       'Frequency = 1 * math.Sqrt(NUMBER_K * g) / 6.28:
        NUMBER_K = 6.28 / (LENGTH):               'K1 = 1 * K0:    K2 = 2 * K0:    K3 = 15 * K0:    K4 = 3 * K0:
        Frequency = 0.3 * Math.Sqrt(NUMBER_K * 9.81) 'Deep water p68

        'Frequency1 = 1 * Frequency:       Frequency2 = 1 * Frequency:   Frequency3 = 1 * Frequency:   Frequency4 = 1 * Frequency:
        'Amplitude1 = 0.5 * Amplitude:     Amplitude2 = 0.2 * Amplitude:   Amplitude3 = 0.2 * Amplitude:   Amplitude4 = 0.1 * Amplitude:
        'PHASE1 = 1 * PHASE:               PHASE2 = 2 * PHASE:             PHASE3 = 5 * PHASE:             PHASE4 = 8 * PHASE:
        'HEADING1 = 1 * HEADING:           HEADING2 = 0.2 * HEADING:         HEADING3 = 0.4 * HEADING:         HEADING4 = 0.8 * HEADING:

        For i = 0  To n01
          ii = 4 * i - 10
          For j = 0  To m01
            jj = 2 * j - m01
            fx = 1 * Amplitude * Math.sin(NUMBER_K * (ii * Math.cos(HEADING0) - jj * Math.sin(HEADING0)) - Frequency * CLOCK + PHASE)
            'fx = fx + Amplitude1 * Math.sin(K1 * (ii * Math.cos(HEADING1) + jj * Math.sin(HEADING1)) + Frequency * CLOCK + PHASE1)
            'fx = fx + Amplitude2 * Math.sin(K2 * (ii * Math.cos(HEADING2) + jj * Math.sin(HEADING2)) + Frequency * CLOCK + PHASE2)
            'fx = fx + Amplitude3 * Math.sin(K3 * (ii * Math.cos(HEADING3) + jj * Math.sin(HEADING3)) + Frequency * CLOCK + PHASE3)
            'fx = fx + Amplitude4 * Math.sin(K4 * (ii * Math.cos(HEADING4) + jj * Math.sin(HEADING4)) + Frequency * CLOCK + PHASE4)
            ptarr.Add(ii, jj, fx)
          Next
        Next
        WAVE = NurbsSurface.CreateFromPoints(ptarr, n01 + 1, m01 + 1, 3, 3)

    End Select

    a = fx


    
    
    '______________________________________________________________________________________________________________________
    jmpFinal:
    SEAPLAN = WAVE

    '  Dim Edgs = WAVE.dup
    'Get Joined Hull naked Edges
    Dim Edgs = WAVE.ToBrep.DuplicateEdgeCurves(True) 'Duplicate only naked Edges
    'C = Edgs

    For Each Elmt As curve In Edgs
      crvarrx.add(Elmt)
      crvarrx.add(New Linecurve(New point3d(Elmt.pointAtStart.x, Elmt.pointAtStart.y, -5), New point3d(Elmt.pointAtEnd.x, Elmt.pointAtEnd.y, -5)))
      Dim Srfx0 = brep.CreateEdgeSurface(crvarrx): crvarrx.Clear:          arra.add(Srfx0)
    Next
    SEADEPTH = arra

    'Sphere ________________________________________________________________________________________________
    Dim Sphere_x = 1
    Dim Sphere_y = -5
    Dim Sphere_PHASE = PHASE
    NUMBER_K = 6.28 / ((5) * LENGTH / n01)

    Select Case WaveOption
      Case 0
        fx = Amplitude * Math.cos(NUMBER_K * sphere_x + Frequency * CLOCK + Sphere_PHASE)

      Case 1
        fx = Amplitude * Harmonique * Math.cos(NUMBER_K * sphere_x + Frequency * CLOCK + Sphere_PHASE)

      Case 2
        fx = Amplitude * Harmonique * Math.cos(NUMBER_K * sphere_x + Frequency * CLOCK + .9 * Sphere_PHASE)
        fx = fx + Amplitude * Harmonique * Math.cos(NUMBER_K * sphere_x * 0.1 + 0.5 * Frequency * CLOCK + Sphere_PHASE)
        fx = fx + Amplitude * Harmonique * Math.cos(NUMBER_K * sphere_x * 0.3 + 0.6 * Frequency * CLOCK + Sphere_PHASE)
        fx = fx + Amplitude * Harmonique * Math.cos(NUMBER_K * sphere_x * 0.7 + 0.7 * Frequency * CLOCK + Sphere_PHASE)
        fx = fx + Amplitude * Harmonique * Math.cos(NUMBER_K * sphere_x * 0.9 + 0.8 * Frequency * CLOCK + Sphere_PHASE)

      Case 3
        fx = Amplitude * Math.cos(NUMBER_K * sphere_x * Math.cos(3.14 / 4) + NUMBER_K * (-5) * Math.sin(3.14 / 4) - Frequency * CLOCK + Sphere_PHASE)

      Case 4
        fx = Amplitude * Math.cos(NUMBER_K * Sphere_x * Math.cos(3.14 / 4) + NUMBER_K * Sphere_y * Math.sin(3.14 / 4) - Frequency * CLOCK + Sphere_PHASE)

      Case 7
        'HEADING0 = HEADING * 3.14 / 180:              'Frequency = 1 * math.Sqrt(NUMBER_K * g) / 6.28:
        NUMBER_K = 6.28 / (LENGTH):                   'K1 = 1 * K0:    K2 = 2 * K0:    K3 = 15 * K0:    K4 = 3 * K0:
        Frequency = 0.3 * Math.Sqrt(NUMBER_K * 9.81)  'Deep water p68

        fx = Amplitude * Math.sin(NUMBER_K * sphere_x * Math.cos(HEADING) + NUMBER_K * sphere_y * Math.sin(HEADING) - 1 * Frequency * CLOCK + PHASE)

    End Select

    Dim sphere As New Rhino.Geometry.Sphere(New point3d(sphere_x, sphere_y, 1 * fx), 1)
    BALL = sphere
    'arrb.add(sphere)
    'GoTo Endp:


    Dim Matrix As New Rhino.Geometry.Transform(1)
    Dim  CosPitch,CosRoll,SinPitch,SinRoll, CosYaw,SinYaw  As Double


    'PdStrip DATA_____________________________________________________________________________________________________________________________________________________________________
    'λ	 Wave angle	SURGE/CAVLEMENT	              SWAY/EMBARDE          	  HEAVE/PILONNEMENT      	  ROLL/ROULIS           	  PITCH/TANGAGE	               YAW/LACET
    '36	      90    (-0.042078998, 0.016402699)  (0.06627333, -2.4726017)  (1.1833588, -0.07419306)  (0.00446707, 0.18109144)  (0.025803443, -0.006196783)  (-0.01685947, 0.02931044)
    '80       90    (-0.59902954, -0.16312408)   (-4.074935,-4.851231)     (1.4014366,0.025448196)   (-0.05602648,0.04892956)  (0.049454387,0.012321376)    (0.06905102,-0.042157944)
    '40       90    (-0.03754425,0.026424408)    (-0.21547908,-2.7222447)  (1.2329811,-0.16302751)   (-0.018815067,0.1575275)  (0.034171257,-0.013598298)   (-0.00794804,0.039699465)
    '________________________________________________________________________________________________________________________________________________________________________________

    'Roll                          Pitch                           Heave
    '(0.00446707, 0.18109144)      (0.025803443, -0.006196783)     (1.1833588, -0.07419306)

    Dim Roll_Amplitude,Roll_Phase  ,Pitch_Amplitude,Pitch_Phase   ,Heave_Amplitude,Heave_Phase     As Double
    Dim TTaRoll,TTaPitch,ZHeave  As Double
    Dim Wave_Amplitude = Amplitude
    Dim TTaYaw = 0
    Dim XSurge,YSway  As Double
    XSurge = 0:  YSway = 0:TTaRoll = 0:TTaPitch = 0:ZHeave = 0:


    'Motion Spectrum Statistics Trial/2
    'Roll_Amplitude = 0.859 * 3.14 / 180:  Pitch_Amplitude = 0.859 * 3.14 / 180:   Heave_Amplitude = 1.073
    'Roll_Phase = 0.18109144:         Pitch_Phase = -0.006196783:    Heave_Phase = -0.07419306
    'SHIP MOTION FROM EXCEL SPECIF --------------------------------------------------------------------------------
    If SHIPMOTIONS(0)  Then  SHIPMOTIONS(0) = 1
    Roll_Amplitude = PlusRoll * SHIPMOTIONS(0):         Arrd.add(Roll_Amplitude)
    Roll_Phase = SHIPMOTIONS(1):                        Arrd.add(Roll_Phase)
    Pitch_Amplitude = PlusPitch * SHIPMOTIONS(2):       Arrd.add(Pitch_Amplitude)
    Pitch_Phase = SHIPMOTIONS(3):                       Arrd.add(Pitch_Phase)
    Heave_Amplitude = PlusHeave * SHIPMOTIONS(4):       Arrd.add(Heave_Amplitude)
    Heave_Phase = SHIPMOTIONS(5):                       Arrd.add(Heave_Phase)
    ' InitiaList = SHIPMOTIONS(14):                     Arrd.add(InitiaList)

    'Roll = Roll_Amplitude
    'MODATA = Arrd

    'SHIP DYNAMICS/BEHAVIOR
    '____________________________________________________________________________________________________
    'PROGRESSIVE HEELING LIST
    If Listplus - InitiaList < 0 Then
      Listplus = Listplus + 1
      If Listplus > InitiaList  Then Listplus = InitiaList
    End If
    If Listplus - InitiaList > 0 Then
      Listplus = Listplus - 1
      If Listplus < InitiaList  Then Listplus = InitiaList
    End If
    '____________________________________________________________________________________________________
    NUMBER_K = 6.28 / LENGTH
    Dim DAMPER As Single  ',iAmplitude

    Select Case WaveOption
      Case 0

        'SIMULATION IS STOPPED ----
        If clock < 1 Then GoTo jmp0:

        Pitch_Amplitude = 0.03:Heave_Amplitude = 0.5
        TTaPitch = Pitch_Amplitude * Wave_Amplitude * math.cos(Frequency * CLOCK + Pitch_Phase)
        ZHeave = Heave_Amplitude * Wave_Amplitude * math.cos(Frequency * CLOCK + 0.1 * Heave_Phase)

        '-----------------
        Dim T = T_Roll * 5
        Roll_Amplitude = PHI
        'Dim T = 20 * 5
        'Dim T = 6 * 5
        'Dim T = 8 * 5

        Frequency = 6.28 / T:       Roll_Phase = 0 'ω=2π/T

        'Clok0  Roll timer RUN/STOP
        If RZ  Then clock0 = 0 Else clock0 + = 1

        'Roll_Amplitude   Roll Progressive  Inclination Behaviour
        If RZ  Then i0 += 1:Roll_Amplitude = i0 * Roll_Amplitude / 10: Else i0 = 0

        'Real Time  Ship Behaviour
        TTaRoll = Roll_Amplitude * math.cos(Frequency * clock0 + Roll_Phase)
        DAMPER = math.Exp(-ROLLDAMPER * clock0)
        TTaRoll = TTaRoll * DAMPER

        'Communicate Data ----------------
        'Computing Factor =500  to be replaced by real time clock******************************
        SHEETSPECIF.range("M199:Q199").value = _
          New Object(){clock0, TTaRoll,DAMPER * Roll_Amplitude,100 * (clock0) / 500,100 * (clock0) / (100 * T_Roll * 5)} 'Exl2 DYNTETA = N199

        jmp0:

      'Kelvin = now()

      Case 1
        'TTaRoll = (-Listplus * 3.14 / 180) + 1 * Roll_Amplitude * Wave_Amplitude * math.cos(Frequency * CLOCK + Roll_Phase)
        TTaPitch = 1 * Pitch_Amplitude * Wave_Amplitude * math.cos(Frequency * CLOCK + Pitch_Phase)
        ZHeave = Heave_Amplitude * Wave_Amplitude * math.cos(Frequency * CLOCK + 0.1 * Heave_Phase)

        TTaRoll = (-Listplus * 3.14 / 180) + 1 * Roll_Amplitude * Wave_Amplitude * math.cos(Frequency * CLOCK + Roll_Phase)
        TTaRoll = TTaRoll * math.Exp(-ROLLDAMPER * CLOCK)

      Case 2
        TTaRoll = (-Listplus * 3.14 / 180) + 1 * Roll_Amplitude * Wave_Amplitude * math.cos(Frequency * CLOCK + Roll_Phase)
        TTaPitch = 1 * Pitch_Amplitude * Wave_Amplitude * math.cos(Frequency * CLOCK + Pitch_Phase)

        fx = Heave_Amplitude * Wave_Amplitude * math.cos(NUMBER_K * 10 + Frequency * CLOCK + 1 * Heave_Phase)
        fx = fx + Amplitude * Harmonique * Math.cos(NUMBER_K * 10 * 0.1 + 0.5 * Frequency * CLOCK + Sphere_PHASE)
        fx = fx + Amplitude * Harmonique * Math.cos(NUMBER_K * 10 * 0.3 + 0.6 * Frequency * CLOCK + Sphere_PHASE)
        fx = fx + Amplitude * Harmonique * Math.cos(NUMBER_K * 10 * 0.7 + 0.7 * Frequency * CLOCK + Sphere_PHASE)
        fx = fx + Amplitude * Harmonique * Math.cos(NUMBER_K * 10 * 0.9 + 0.8 * Frequency * CLOCK + Sphere_PHASE)
        ZHeave = fx

      Case 3,4
        TTaRoll = (-Listplus * 3.14 / 180) + Roll_Amplitude * Wave_Amplitude * math.cos(NUMBER_K * Math.cos(3.14 / 1) + NUMBER_K * Math.sin(3.14 / 1) - Frequency * CLOCK + Roll_Phase)
        TTaPitch = Pitch_Amplitude * Wave_Amplitude * math.cos(NUMBER_K * Math.cos(3.14 / 1) + NUMBER_K * Math.sin(3.14 / 1) - Frequency * CLOCK + 1 * Pitch_Phase)
        ZHeave = 0.7 * Heave_Amplitude * Wave_Amplitude * math.cos(NUMBER_K * Math.cos(3.14 / 4) * 10 + NUMBER_K * Math.sin(3.14 / 4) * 0 - Frequency * CLOCK + Heave_Phase)

      Case 6
        'WAVE = NurbsSurface.CreateFromPoints(ptarr, n01 + 1, m01 + 1, 3, 3)
        TTaRoll = (-Listplus * 3.14 / 180) + Roll_Amplitude * Wave_Amplitude * math.cos(NUMBER_K * Math.cos(3.14 / 1) + NUMBER_K * Math.sin(3.14 / 1) - Frequency * CLOCK + Roll_Phase)
        TTaPitch = Pitch_Amplitude * Wave_Amplitude * math.cos(NUMBER_K * Math.cos(3.14 / 1) + NUMBER_K * Math.sin(3.14 / 1) - Frequency * CLOCK + 1 * Pitch_Phase)
        ZHeave = 1 * Heave_Amplitude * Wave_Amplitude * math.cos(NUMBER_K * Math.cos(3.14 / 4) * 10 + NUMBER_K * Math.sin(3.14 / 4) * 0 - Frequency * CLOCK + Heave_Phase)

      Case 7
        Dim SHIP_X,SHIP_Y  As Single
        SHIP_X = 10:   SHIP_Y = 0
        Roll_Amplitude = 0.07
        ii = SHIP_X:   jj = SHIP_Y
        'fx = Amplitude * Math.sin(NUMBER_K * ii * Math.cos(HEADING) + NUMBER_K * jj * Math.sin(HEADING) + Frequency * CLOCK + PHASE)

        TTaRoll = (-Listplus * 3.14 / 180) + Roll_Amplitude * Wave_Amplitude * math.sin(ii * NUMBER_K * Math.cos(HEADING) + jj * NUMBER_K * Math.sin(HEADING) - Frequency * CLOCK + Roll_Phase)
        TTaPitch = 0.5 * Pitch_Amplitude * Wave_Amplitude * math.sin(ii * NUMBER_K * Math.cos(HEADING) + jj * NUMBER_K * Math.sin(HEADING) - Frequency * CLOCK + Pitch_Phase)
        ZHeave = 0.5 * Heave_Amplitude * Wave_Amplitude * math.sin(ii * NUMBER_K * Math.cos(HEADING) + jj * NUMBER_K * Math.sin(HEADING) - Frequency * CLOCK + Heave_Phase)

    End Select

    'TTaRoll = math.Exp(-0.15 * CLOCK) * TTaRoll
    ' TTaRoll = math.Exp(1.5 * CLOCK) * TTaRoll

    'arrc.add(geo(0))
    'geo(0).translate(-10, 0, 0)
    'Geomat = arrc
    'Exit Sub
    'Exlarray(0, 0) = clock0:     Exlarray(0, 1) = TTaRollDRAW
    'SHEETSPECIF.range("M199:N199").value = xlApp.WorksheetFunction.Transpose(Exlarray)

    'TTaRoll = TTaRollDRAW
    'Matrix transformation
    CosPitch = math.Cos((TTaPitch)):     CosRoll = math.Cos((TTaRoll))
    SinPitch = math.Sin((TTaPitch)):     SinRoll = math.Sin((TTaRoll))
    CosYaw = math.Cos((TTaYaw)):         SinYaw = math.Sin((TTaYaw))

    'Matrix(0, 0) = CosPitch:             Matrix(0, 1) = 0:         Matrix(0, 2) = -SinPitch:            Matrix(0, 3) = XSurge '* SinPitch
    'Matrix(1, 0) = SinRoll * SinPitch:   Matrix(1, 1) = CosRoll:   Matrix(1, 2) = SinRoll * CosPitch:   Matrix(1, 3) = YSway  '* SinRoll * CosPitch
    'Matrix(2, 0) = CosRoll * SinPitch:   Matrix(2, 1) = -SinRoll:  Matrix(2, 2) = CosRoll * CosPitch:   Matrix(2, 3) = ZHeave '* CosRoll * CosPitch
    'Matrix(3, 0) = 0:                    Matrix(3, 1) = 0:         Matrix(3, 2) = 0:                    Matrix(3, 3) = 1

    Matrix(0, 0) = CosPitch:             Matrix(0, 1) = 0:         Matrix(0, 2) = SinPitch:              Matrix(0, 3) = 10 + XSurge '* SinPitch
    Matrix(1, 0) = SinRoll * SinPitch:   Matrix(1, 1) = CosRoll:   Matrix(1, 2) = -SinRoll * CosPitch:   Matrix(1, 3) = YSway  '* SinRoll * CosPitch
    Matrix(2, 0) = -CosRoll * SinPitch:  Matrix(2, 1) = SinRoll:   Matrix(2, 2) = CosRoll * CosPitch:    Matrix(2, 3) = ZHeave '* CosRoll * CosPitch
    Matrix(3, 0) = 0:                    Matrix(3, 1) = 0:         Matrix(3, 2) = 0:                     Matrix(3, 3) = 1
    'Transform input geometry using the matrix

    Try
      For Each Elmt As geometryBase In geo  'Edgs
        Elmt.translate(-10, 0, -2)
        Elmt.Transform(matrix)
        arrc.add(Elmt)
      Next
    Catch
    End Try

    'PILON
    'Dim Pilon = New Linecurve(New Point3d(10, 0, 4), New Point3d(10, 0, 15)):    BPLAN.add(Pilon)
    'Pilon = New Linecurve(New Point3d(10, 0, 4), New Point3d(30, 0, 3)):         BPLAN.add(Pilon)
    'Pilon = New Linecurve(New Point3d(10, 0, 4), New Point3d(10, 15, 3)):        BPLAN.add(Pilon)

    Try
      For Each Elmt As geometryBase In BPLAN  'Edgs
        Elmt.translate(-10, 0, -2)
        Elmt.Transform(matrix)
        arrb.add(Elmt)
      Next
    Catch
    End Try


    'SHIP PRPERE----------------------------------------------------------------
    Dim ArrArow0,ArrArow,ArrArow1,ArrArow2  As New list(Of Object)

    Dim pnt0 = New Point3d(0, 0, 3):      ArrArow0.add(pnt0):
    Dim Vctorx = New Vector3d(20, 0, 0):  ArrArow0.add(Vctorx)
    Dim Vctory = New Vector3d(0, 15, 0):  ArrArow0.add(Vctory)
    Dim Vctorz = New Vector3d(0, 0, 10):  ArrArow0.add(Vctorz)

    Try
      For Each Elmt As Object In ArrArow0  'Edgs
        Elmt.Transform(matrix)
        ArrArow.add(Elmt)
      Next
    Catch
    End Try
    ArrArow1.add(ArrArow(1)):  ArrArow1.add(ArrArow(2)): ArrArow1.add(ArrArow(3))

    P = ArrArow(0) 'Vectors Arrows Center
    V = ArrArow1   'Vectors Arrows

    Geomat = arrc
    BPlanmat = arrb
    Endp:
    'Exit Sub

    'HEADING---------------------------------------------------------------------------------
    Dim Tan = HEADING * 3.14 / 180
    Dim  dz,dy  As Single
    Dim Pnt1,Pnt2 As New Point3d
    dz = 4: dy = 17

    'Vectors
    pnt0 = New Point3d(10, -dy, dz) 'Vectors Reference Centers
    Vctorx = New Vector3d(20, 0, 0):                                     ArrArow2.add(Vctorx)
    Vctory = New Vector3d(4, 0, 0)
    Vctory.transform(transform.Rotation(Tan, New Point3d(10, -dy, dz))):  ArrArow2.add(Vctory)
    'Display Vectors
    P2 = pnt0     'Vectors Arrows Center
    V2 = ArrArow2 'Vectors Arrows

    'Headaing Track points
    Pnt1 = New Point3d(pnt0.x + 4.5, pnt0.y, pnt0.z): 'arrb.add(Pnt1)
    Pnt2 = New Point3d(pnt0.x + 4.5, pnt0.y, pnt0.z): 'arrb.add(Pnt2)
    Pnt2.transform(transform.Rotation(Tan, New Point3d(10, -dy, 3)))

    'Angular Dimensionn------------------------------
    Dim DimCtr,DimPnt12,DimPnt22 As New Point3dList
    Dim DIMTITLE,DIMTITLE2 As New list(Of String)

    Tan = math.Tan(HEADING * 3.14 / 180)
    Dim DIMPOINT = New Point3d(10, -dy, dz)
    DimCtr.add(DIMPOINT):
    DimPnt12.add(Pnt1):
    DimPnt22.add(Pnt2):
    DIMTITLE.add("Waves Heading " & CStr(HEADING))
    '-----------------------------------------------

    DIMCNTR = DimCtr
    DIMPNT1 = DimPnt12
    DIMPNT2 = DimPnt22
    DIMTXT = DIMTITLE

    'Roll = RAND
    'M = matrix
    'i_i = TTaRoll
# ---------- motion_solver: VB additional code ----------
  Dim WAVE
  Dim Listplus As int32
  Dim KelvinStep As int32
  Dim KelvinCrv(0) As curve
  Dim OUTOUF0 As Double
  Dim CLOCK0 As Single
  Dim i0 As int32

  ''' <summary>
  ''' This method will be called once every solution, before any calls to RunScript.
  ''' </summary>
  Public Overrides Sub BeforeRunScript()
  End Sub
  ''' <summary>
  ''' This method will be called once every solution, after any calls to RunScript.
  ''' </summary>
  Public Overrides Sub AfterRunScript()
  End Sub
# ---------- end motion_solver ----------

ship = ColourSwatch(SwatchColor=RGB(191, 177, 15))
ball = ColourSwatch(SwatchColor=RGB(112, 28, 214))
ball_2 = ColourSwatch(SwatchColor=RGB(214, 28, 28))
sea_plan = ColourSwatch(SwatchColor=RGBA(72, 168, 219, 199))
# PEAK AV
sae_depth = ColourSwatch(SwatchColor=RGBA(70, 155, 212, 188))
cluster = Cluster(
    ship=motion_solver.Geomat,
    color_5=ship,
    bodyplan=motion_solver.BPlanmat,
    color_3=ball,
    ball=motion_solver.BALL,
    color_4=ball_2,
    sea_plan=motion_solver.SEAPLAN,
    color_2=sea_plan,
    sea_depth=motion_solver.SEADEPTH,
    color=sae_depth)

panel_9 = Panel(motion_solver.MODATA)
geo_3 = Geometry(motion_solver.SEAPLAN)
heading_2 = AngularDimension(
    Center=motion_solver.DIMCNTR,
    PointA=motion_solver.DIMPNT1,
    PointB=motion_solver.DIMPNT2,
    Reflex=True,
    Text=motion_solver.DIMTXT,
    Size=0.7)
arrows = Arrows(A=motion_solver.P, V=motion_solver.V, A_2=motion_solver.P2, V_2=motion_solver.V2)
preview = CustomPreview(Geometry=motion_solver.V, Shader=ColourSwatch(SwatchColor=RGB(222, 27, 27)))  # disabled

# ==== cluster Cluster
bodyplan = ClusterInput()
sea_depth = ClusterInput()
color = ClusterInput()
sea_plan = ClusterInput()
color_2 = ClusterInput()
color_3 = ClusterInput()
ball = ClusterInput()
color_4 = ClusterInput()
ship = ClusterInput()
color_5 = ClusterInput()
bodyplan_2 = CustomPreview(Geometry=bodyplan, Shader=color_3)
sea = CustomPreview(SEADEPTH=sea_depth, Shader=color)
sea_2 = CustomPreview(Geometry=sea_plan, Shader=color_2)
ball_2 = CustomPreview(Geometry=ball, Shader=color_4)
ship_2 = CustomPreview(Geometry=ship, Shader=color_5)

# ==== cluster Arrows
A = ClusterInput()
V = ClusterInput()
A_2 = ClusterInput()
V_2 = ClusterInput()
vdis = VectorDisplay(Anchor=A, Vector=V)
vdis_2 = VectorDisplay(Anchor=A_2, Vector=V_2)
